# Grasshopper definition parametric notched tile.gh (Grasshopper 1.0.8)

# adjust the length of the horizontal notch how you wish your tiles to fit together
number_slider = Slider(10, range=0..50)
# adjust the width of the horizontal notch to fit material thickness
number_slider_2 = Slider(1, range=0..50)
# adjust the width of the vertical notch to fit material thickness
number_slider_3 = Slider(1, range=0..50)
# adjust the height and width of your rectangular tile
number_slider_4 = Slider(30, range=30..50)
# adjust the length of the vertical notch how you wish your tiles to fit together
number_slider_5 = Slider(10, range=0..50)
# slide your horizontal notch up and down across the tile
number_slider_6 = Slider(20, range=1..50)
# slide your vertical notch across the tile from side to side
number_slider_7 = Slider(20, range=1..50)
rectangle_horizontal_notch = Rectangle(Plane=PlaneXY(0, 0, 0), XSize=number_slider, YSize=number_slider_2, Radius=0)  # -> Rectangle, Length
rectangle_vertical_notch = Rectangle(Plane=PlaneXY(0, 0, 0), XSize=number_slider_3, YSize=number_slider_5, Radius=0)  # -> Rectangle, Length
unit_y = UnitY(Factor=number_slider_6)
unit_x = UnitX(Factor=number_slider_7)
move = Move(Geometry=rectangle_vertical_notch.Rectangle, Motion=unit_x)  # -> Geometry, Transform
move_2 = Move(Geometry=rectangle_horizontal_notch.Rectangle, Motion=unit_y)  # -> Geometry, Transform
# bake everything
# in this column!
rectangle = Rectangle(Plane=PlaneXY(0, 0, 0), XSize=number_slider_4, YSize=Slider(30, range=30..40), Radius=0)  # -> Rectangle, Length
